# Grasshopper definition 211207_CEM_Bridge_PD.gh (Grasshopper 1.0.7)
# plug-ins: CEM_Load, CEM_Support, CEM_Trail, CEM_Deviation, CEM_Build_Topology, CEM_Extract_Topology, CEM_Constraint_Plane, CEM_Extract_Structure, CEM_Material_Properties, Kangaroo2 Components, CEM_Calculate_Structure, CEM_Origin_Node

# ---- group: Live Loads
pt = Point([<point referenced from the Rhino model> x40])
cem_load = CEM_Load(PointLoad=pt, LoadMagnZ=Slider(-1.1, range=-5..5))

# ---- group: Deviations Top
dev_1_2 = Curve([<curve referenced from the Rhino model> x2])
dev_0 = Curve(<curve referenced from the Rhino model>)
dev_3_4 = Curve([<curve referenced from the Rhino model> x2])
cem_deviation = CEM_Deviation(DeviationEdge=dev_1_2, DeviationMagn=Slider(-95.4, range=-100..100))
cem_deviation_2 = CEM_Deviation(DeviationEdge=dev_0, DeviationMagn=Slider(-74.7, range=-100..100))
cem_deviation_3 = CEM_Deviation(DeviationEdge=dev_3_4, DeviationMagn=Slider(-24.6, range=-100..100))

dev_2_3_4 = Curve([<curve referenced from the Rhino model> x20])
dev_0_1_2 = Curve([<curve referenced from the Rhino model> x20])
cem_deviation_4 = CEM_Deviation(DeviationEdge=dev_2_3_4, DeviationMagn=Slider(-5, range=-100..100))
cem_deviation_5 = CEM_Deviation(DeviationEdge=dev_0_1_2, DeviationMagn=Slider(-8, range=-100..100))

# ---- group: Deviations Bottom
dev_1_2_2 = Curve([<curve referenced from the Rhino model> x2])
dev_0_2 = Curve(<curve referenced from the Rhino model>)
dev_3_4_2 = Curve([<curve referenced from the Rhino model> x2])
cem_deviation_6 = CEM_Deviation(DeviationEdge=dev_1_2_2, DeviationMagn=Slider(91.4, range=-100..100))
cem_deviation_7 = CEM_Deviation(DeviationEdge=dev_0_2, DeviationMagn=Slider(42.6, range=-100..200))
cem_deviation_8 = CEM_Deviation(DeviationEdge=dev_3_4_2, DeviationMagn=Slider(111.4, range=-100..200))

# ---- group: Intermediate Deviations
dev_1_2_3 = Curve([<curve referenced from the Rhino model> x20])
dev_0_3 = Curve([<curve referenced from the Rhino model> x10])
dev_3_4_3 = Curve([<curve referenced from the Rhino model> x20])
cem_deviation_9 = CEM_Deviation(DeviationEdge=dev_1_2_3, DeviationMagn=Slider(5, range=-100..100))
cem_deviation_10 = CEM_Deviation(DeviationEdge=dev_0_3, DeviationMagn=Slider(5, range=-100..100))
cem_deviation_11 = CEM_Deviation(DeviationEdge=dev_3_4_3, DeviationMagn=Slider(5, range=-100..100))

# ---- group: Deviations Bottom
dev_2_3_4_2 = Curve([<curve referenced from the Rhino model> x20])
dev_0_1_2_2 = Curve([<curve referenced from the Rhino model> x20])
cem_deviation_12 = CEM_Deviation(DeviationEdge=dev_2_3_4_2, DeviationMagn=Slider(8.5, range=-100..100))
cem_deviation_13 = CEM_Deviation(DeviationEdge=dev_0_1_2_2, DeviationMagn=Slider(10.7, range=-100..100))

# ---- group: Trails Top
trail_0 = Curve([<curve referenced from the Rhino model> x8])
trails_1_2 = Curve([<curve referenced from the Rhino model> x16])
trails_3_4 = Curve([<curve referenced from the Rhino model> x16])
cem_trail = CEM_Trail(TrailEdge=[trail_0, trails_1_2, trails_3_4], TrailLen=1)

# ---- group: Trails Bottom
trail_0_2 = Curve([<curve referenced from the Rhino model> x8])
trails_1_2_2 = Curve([<curve referenced from the Rhino model> x16])
trails_3_4_2 = Curve([<curve referenced from the Rhino model> x16])
cem_trail_2 = CEM_Trail(TrailEdge=[trail_0_2, trails_1_2_2, trails_3_4_2], TrailLen=1)

# ---- group: Supports
pt_2 = Point([<point referenced from the Rhino model> x20])
cem_support = CEM_Support(Support=pt_2)

# ---- group: Topology
cem_build_topology = CEM_Build_Topology(
    T=[cem_trail, cem_trail_2],
    L=cem_load,
    D=[cem_deviation_2, cem_deviation, cem_deviation_3, cem_deviation_5, cem_deviation_4, cem_deviation_7, cem_deviation_6, cem_deviation_8, cem_deviation_13, cem_deviation_12, cem_deviation_10, cem_deviation_9, cem_deviation_11],
    S=cem_support)
cem_extract_topology = CEM_Extract_Topology(TP=cem_build_topology)  # -> Nodes, NodesID, Edges, EdgesID, ConstraintPlane, ConstraintPlaneID, OriginNode, OriginNodeID
tag = TextTag(Location=cem_extract_topology.OriginNode, Text=cem_extract_topology.OriginNodeID)

# ---- group: Structural Model
pt_3 = Point(<point referenced from the Rhino model>)
pt_4 = Point([<point referenced from the Rhino model> x19])
yieldstress_kn_m2 = Slider(50000, range=50..1000000)
specific_weight_kn_m3 = Slider(25, range=5..500)
merge = Merge(Data1=pt_3, Data2=pt_4)
cem_constraint_plane = CEM_Constraint_Plane(ConstraintPlane=cem_extract_topology.ConstraintPlane, ConstraintPlaneID=cem_extract_topology.ConstraintPlaneID)
cem_material_properties = CEM_Material_Properties(SelfWeight=Toggle(True), YieldStress=yieldstress_kn_m2, SpecWeight=specific_weight_kn_m3)

# ----
cem_origin_node = CEM_Origin_Node(OriginNode=merge, OriginNodeID=cem_extract_topology.OriginNodeID)
cem_calculate_structure = CEM_Calculate_Structure(TP=cem_build_topology, CPL=cem_constraint_plane, N=cem_origin_node, SW=cem_material_properties)

# ---- group: Structural Model (continued)
cem_extract_structure = CEM_Extract_Structure(M=cem_calculate_structure)  # -> Nodes, NodesID, Trails, TrailsID, TrailsCol, TrailsMag, Deviations, DeviationsID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

# ---- group: Visualization
end = EndPoints(Curve=cem_extract_structure.ExternalForces)  # -> Start, End
scale = Scale(Geometry=cem_extract_structure.ExternalForces, Center=end.Start, Factor=0.01)  # -> Geometry, Transform
preview = CustomPreview(
    Geometry=[cem_extract_structure.Trails, cem_extract_structure.Deviations, scale.Geometry],
    Material=[cem_extract_structure.TrailsCol, cem_extract_structure.DeviationsCol, cem_extract_structure.ExternalForcesCol])

# ----
panel = Panel(cem_extract_structure.TrailsMag)

# ---- group: Geometric Postprocessing
merge_2 = Merge(Data1=cem_extract_structure.Trails, Data2=cem_extract_structure.Deviations)  # disabled
merge_3 = Merge(Data1=cem_extract_structure.TrailsMag, Data2=cem_extract_structure.DeviationsMag)  # disabled
smaller = SmallerThan(FirstNumber=merge_3, SecondNumber=0)  # -> SmallerThan, OrEqualTo; disabled
larger = LargerThan(FirstNumber=merge_3, SecondNumber=0)  # -> LargerThan, OrEqualTo; disabled
cull = CullPattern(List=merge_2, CullPattern=smaller.SmallerThan)  # disabled
cull_2 = CullPattern(List=merge_2, CullPattern=larger.LargerThan)  # disabled
mp = MultiPipe(Curves=cull, NodeSize=0.025, EndOffset=1, StrutSize=0.5, Segment=0, KinkAngle=0.6, CubeFit=0, Caps=0)  # disabled
mp_2 = MultiPipe(Curves=cull_2, NodeSize=0.01, EndOffset=1, StrutSize=0.5, Segment=0, KinkAngle=0.6, CubeFit=0, Caps=0)  # disabled
pipe = Pipe(Curve=cull_2, Radius=0.0025, Caps=0)  # -> flatten(Pipe); disabled
preview_2 = CustomPreview(
    Geometry=pipe,
    Material={diffuse=RGB(105, 105, 105), emission=RGB(0, 0, 0), shine=0.5, specular=RGB(255, 255, 255), transparency=0})  # disabled
preview_3 = CustomPreview(
    Geometry=mp,
    Material={diffuse=RGB(192, 192, 192), emission=RGB(0, 0, 0), shine=0.5, specular=RGB(255, 255, 255), transparency=0})  # disabled
