# Grasshopper definition BridgeTheGap_Example.ghx (Grasshopper 1.0.7)

fictive_geometry_input = GhPythonScript()  # -> out, geometry
# ---------- fictive_geometry_input: Python ----------
__author__ = "julia"
__version__ = "2021.10.14"

import rhinoscriptsyntax as rs

part1 = [[4.0, 3.2, 1.0], [-1.0, 0.0, 0.0], [0.0, 1.0, 0.0], [.81, 0.05, 0.05]]
part2 = [[4.0, 3.2, 1.0], [-1.0, 0.0, 0.0], [0.0, 1.0, 0.0], [.92, 0.05, 0.05]]
part3 = [[4.0, 3.2, 1.0], [-1.0, 0.0, 0.0], [0.0, 1.0, 0.0], [.56, 0.05, 0.05]]
part4 = [[4.0, 3.2, 1.0], [-1.0, 0.0, 0.0], [0.0, 1.0, 0.0], [.34, 0.05, 0.05]]

geometry = [part1, part2, part3, part4]
# ---------- end fictive_geometry_input ----------

# ----
# Pickup Plane Reference Point (bottom right)
number_slider = Slider(0, range=-2..2)
X = UnitX(Factor=1)
Y = UnitY(Factor=1)
pt = ConstructPoint(XCoordinate=Slider(0.97, range=-2..2), YCoordinate=Slider(1.21, range=-2..2), ZCoordinate=number_slider)
rev = Reverse(Vector=X)
pl = ConstructPlane(Origin=pt, XAxis=rev, YAxis=Y)

path = GhPythonScript()  # -> out, DATA
# ---------- path: Python ----------
__author__ = "julia"
__version__ = "2021.10.15"

import rhinoscriptsyntax as rs
import os
import getpass
import sys
username = getpass.getuser()
USER_FOLDER = os.path.abspath(os.path.join("C:/Users/", username))
DATA = os.path.abspath(os.path.join(USER_FOLDER,"workspace/projects/bridgethegap_sample_assembly/src/bridgethegap_example/assembly"))
print(DATA)
if not DATA in sys.path:
    sys.path.append(DATA)
# ---------- end path ----------
aim = GhPythonScript(
    DATA=path.DATA,
    geometry=fictive_geometry_input.geometry,
    safe_plane_distance=Slider(0.23, range=0..0.5),
    pick_plane_reference=pl)  # -> out, myAssembly; inputs geometry: list
# ---------- aim: Python ----------
from __future__ import absolute_import
from __future__ import print_function

__author__ = "julia"
__version__ = "2021.10.14"

import rhinoscriptsyntax as rs
import sys
from compas.geometry import Frame, Point, Vector
from compas.geometry import Point, Frame, Vector
from assembly import BridgeAssembly
from element import BridgeElement
if not DATA in sys.path:
    sys.path.append(DATA)

my_elements = []
myFrame = Frame(Point(0.2, 0.2, 0.2), Vector(-1,0,0), Vector(0,1,0))

pick_frame_reference = Frame(pick_plane_reference.Origin, pick_plane_reference.XAxis,
    pick_plane_reference.YAxis)


for id, object in enumerate(geometry):
    object_frame = Frame(object[0], object[1], object[2])
    object_profile = object[3]
    my_element = BridgeElement(id, object_frame, object_profile)
    my_elements.append(my_element)

myAssembly = BridgeAssembly(my_elements, pick_frame_reference, safe_plane_distance)
myAssembly.prepare_assembly()
# ---------- end aim ----------
