# Grasshopper definition bridge_the_gap_CEM_Karamba.ghx (Grasshopper 1.0.7)
# plug-ins: CEM_Trail, CEM_Load, CEM_Deviation, CEM_Support, CEM_Build_Topology, CEM_Extract_Topology, CEM_Bound_Origin_Node, CEM_Origin_Node, CEM_Material_Properties, CEM_Target, CEM_Bound_Trail, CEM_Bound_Deviation, CEM_Optimization_Setup, CEM_Calculate_Structure, CEM_Extract_Structure, karambaGH, Kangaroo2 Components

# ----
# CEM TOPOLOGY DIAGRAM
deviationmagn = Slider(-17, range=-20..0)
deviationmagn_2 = Slider(2.75, range=-10..10)
loadmagnx = Slider(0, range=-10..10)
loadmagny = Slider(-3.5, range=-10..10)
loadmagnz = Slider(0, range=-10..10)
traillen = Slider(-0.85, range=-2..2)
deviationmagn_3 = Slider(-3.6, range=-20..20)
deviationedge = Line(flatten(Line((3, 1, 0), (4, 1, 0))))
deviationedge_2 = Line(flatten([Line((1, 1, 0), (1, 0, 0)), Line((2, 1, 0), (2, 0, 0)), Line((3, 1, 0), (3, 0, 0)), Line((4, 1, 0), (4, 0, 0)), Line((5, 1, 0), (5, 0, 0)), Line((6, 1, 0), (6, 0, 0))]))
deviationedge_3 = Line(flatten(Line((3, 0, 0), (4, 0, 0))))
curve = Curve(reparameterize([<curve referenced from the Rhino model> x12]))
pointload = Point([<point referenced from the Rhino model> x6])
support = Point([<point referenced from the Rhino model> x4])
cem_trail = CEM_Trail(TrailEdge=flatten(curve), TrailLen=flatten(traillen))
cem_load = CEM_Load(PointLoad=flatten(pointload), LoadMagnX=flatten(loadmagnx), LoadMagnY=flatten(loadmagny), LoadMagnZ=flatten(loadmagnz))
cem_deviation = CEM_Deviation(DeviationEdge=flatten(deviationedge), DeviationMagn=flatten(deviationmagn))
cem_deviation_2 = CEM_Deviation(DeviationEdge=flatten(deviationedge_2), DeviationMagn=flatten(deviationmagn_2))
cem_deviation_3 = CEM_Deviation(DeviationEdge=flatten(deviationedge_3), DeviationMagn=flatten(deviationmagn_3))
cem_support = CEM_Support(Support=flatten(support))
cem_build_topology = CEM_Build_Topology(T=cem_trail, L=cem_load, D=[cem_deviation, cem_deviation_2, cem_deviation_3], S=cem_support)
cem_extract_topology = CEM_Extract_Topology(TP=cem_build_topology)  # -> Nodes, NodesID, Edges, EdgesID, ConstraintPlane, ConstraintPlaneID, OriginNode, OriginNodeID

# ----
# CEM TOPOLOGY DIAGRAM
deviationmagn_4 = Slider(-17, range=-20..0)  # disabled
deviationmagn_5 = Slider(2.75, range=-10..10)  # disabled
loadmagnx_2 = Slider(0, range=-10..10)  # disabled
loadmagny_2 = Slider(-3.5, range=-10..10)  # disabled
loadmagnz_2 = Slider(0, range=-10..10)  # disabled
traillen_2 = Slider(-0.85, range=-2..2)  # disabled
deviationmagn_6 = Slider(-3.6, range=-20..20)  # disabled
deviationedge_4 = Line(flatten(Line((3, 1, 0), (4, 1, 0))))  # disabled
deviationedge_5 = Line(flatten([Line((1, 1, 0), (1, 0, 0)), Line((2, 1, 0), (2, 0, 0)), Line((3, 1, 0), (3, 0, 0)), Line((4, 1, 0), (4, 0, 0)), Line((5, 1, 0), (5, 0, 0)), Line((6, 1, 0), (6, 0, 0))]))  # disabled
deviationedge_6 = Line(flatten(Line((3, 0, 0), (4, 0, 0))))  # disabled
curve_2 = Curve(reparameterize([<curve referenced from the Rhino model> x12]))  # disabled
pointload_2 = Point([<point referenced from the Rhino model> x6])  # disabled
support_2 = Point([<point referenced from the Rhino model> x4])  # disabled
cem_trail_2 = CEM_Trail(TrailEdge=flatten(curve_2), TrailLen=flatten(traillen_2))  # disabled
cem_load_2 = CEM_Load(
    PointLoad=flatten(pointload_2),
    LoadMagnX=flatten(loadmagnx_2),
    LoadMagnY=flatten(loadmagny_2),
    LoadMagnZ=flatten(loadmagnz_2))  # disabled
cem_deviation_4 = CEM_Deviation(DeviationEdge=flatten(deviationedge_4), DeviationMagn=flatten(deviationmagn_4))  # disabled
cem_deviation_5 = CEM_Deviation(DeviationEdge=flatten(deviationedge_5), DeviationMagn=flatten(deviationmagn_5))  # disabled
cem_deviation_6 = CEM_Deviation(DeviationEdge=flatten(deviationedge_6), DeviationMagn=flatten(deviationmagn_6))  # disabled
cem_support_2 = CEM_Support(Support=flatten(support_2))  # disabled
cem_build_topology_2 = CEM_Build_Topology(T=cem_trail_2, L=cem_load_2, D=[cem_deviation_4, cem_deviation_5, cem_deviation_6], S=cem_support_2)  # disabled
cem_extract_topology_2 = CEM_Extract_Topology(TP=cem_build_topology_2)  # -> Nodes, NodesID, Edges, EdgesID, ConstraintPlane, ConstraintPlaneID, OriginNode, OriginNodeID; disabled

panel = Panel("0")  # disabled
targetnode = Point([<point referenced from the Rhino model> x4])

# ----
# CEM FORM DIAGRAM
merge = Merge(Data1=deviationedge, Data2=deviationedge_3, Data3=deviationedge_2)  # -> flatten(Result)
list_length = ListLength(List=flatten(curve))
list_length_2 = ListLength(List=flatten(merge))
series = Series(Start=0, Step=1, Count=list_length)
series_2 = Series(Start=0, Step=1, Count=list_length_2)
boundscoefforiginnode = Slider(0.05, range=0..1)
panel_2 = Panel("""15
3
7
11""")
specific_weight_kn_m3 = Slider(77.5, range=50..300)
yieldstress_kn_m2 = Slider(550000, range=100000..1000000)
targetnodecoeff = Slider(1, range=0..50)
boundlowtrail = Slider(0.3, range=0..100)
bounduptrail = Slider(0.3, range=0..10)
boundlowdev = Slider(30, range=0..100)
boundupdev = Slider(30, range=0..100)
self_weight = BooleanToggle(False)
originnode = Point([<point referenced from the Rhino model> x4])
cem_origin_node = CEM_Origin_Node(OriginNode=flatten(originnode), OriginNodeID=flatten(cem_extract_topology.OriginNodeID))
cem_material_properties = CEM_Material_Properties(SelfWeight=self_weight, YieldStress=yieldstress_kn_m2, SpecWeight=specific_weight_kn_m3)
cem_target = CEM_Target(TargetNode=flatten(targetnode), TargetNodeID=flatten(panel_2), TargetNodeCoeff=flatten(targetnodecoeff))
cem_bound_origin_node = CEM_Bound_Origin_Node(
    BoundOriginNodeID=flatten(cem_extract_topology.OriginNodeID),
    BoundUpOriginNodeX=flatten(boundscoefforiginnode),
    BoundLowOriginNodeX=flatten(boundscoefforiginnode),
    BoundUpOriginNodeY=flatten(boundscoefforiginnode),
    BoundLowOriginNodeY=flatten(boundscoefforiginnode),
    BoundUpOriginNodeZ=flatten("0"),
    BoundLowOriginNodeZ=flatten("0"))
cem_bound_trail = CEM_Bound_Trail(BoundTrailID=flatten(series), BoundUpTrail=flatten(bounduptrail), BoundLowTrail=flatten(boundlowtrail))
cem_bound_deviation = CEM_Bound_Deviation(BoundDevID=flatten(series_2), BoundUpDev=flatten(boundupdev), BoundLowDev=flatten(boundlowdev))
relativetolerance = Slider(1e-05, range=0..0.1)
gradientdelta = Slider(0.003083, range=0..0.1)
maxiterations = Slider(100, range=1..100)
value_list = ValueList({"LD_AUGLAG", "LD_LBFGS", "LD_SLSQP", "LD_TNEWTON", "LN_BOBYQA", "LN_COBYLA", "LN_SBPLX", "GD_MLSL", "GN_MLSL", "GN_ISRES"}, selected="LD_LBFGS")
cem_optimization_setup = CEM_Optimization_Setup(
    TO=cem_target,
    BO=cem_bound_origin_node,
    BT=cem_bound_trail,
    BD=cem_bound_deviation,
    GradientDelta=gradientdelta,
    RelativeTolerance=relativetolerance,
    OptimAlgorithm=value_list)

targetnode_2 = Point([<point referenced from the Rhino model> x4])  # disabled

# ----
# CEM FORM DIAGRAM
merge_2 = Merge(Data1=deviationedge_4, Data2=deviationedge_6, Data3=deviationedge_5)  # -> flatten(Result); disabled
list_length_3 = ListLength(List=flatten(curve_2))  # disabled
list_length_4 = ListLength(List=flatten(merge_2))  # disabled
series_3 = Series(Start=0, Step=1, Count=list_length_3)  # disabled
series_4 = Series(Start=0, Step=1, Count=list_length_4)  # disabled
boundscoefforiginnode_2 = Slider(0.05, range=0..1)  # disabled
panel_3 = Panel("""15
3
7
11""")  # disabled
specific_weight_kn_m3_2 = Slider(77.5, range=50..300)  # disabled
yieldstress_kn_m2_2 = Slider(550000, range=100000..1000000)  # disabled
targetnodecoeff_2 = Slider(1, range=0..50)  # disabled
boundlowtrail_2 = Slider(0.3, range=0..100)  # disabled
bounduptrail_2 = Slider(0.3, range=0..10)  # disabled
boundlowdev_2 = Slider(30, range=0..100)  # disabled
boundupdev_2 = Slider(30, range=0..100)  # disabled
self_weight_2 = BooleanToggle(False)  # disabled
originnode_2 = Point([<point referenced from the Rhino model> x4])  # disabled
cem_origin_node_2 = CEM_Origin_Node(OriginNode=flatten(originnode_2), OriginNodeID=flatten(cem_extract_topology_2.OriginNodeID))  # disabled
cem_material_properties_2 = CEM_Material_Properties(SelfWeight=self_weight_2, YieldStress=yieldstress_kn_m2_2, SpecWeight=specific_weight_kn_m3_2)  # disabled
cem_target_2 = CEM_Target(TargetNode=flatten(targetnode_2), TargetNodeID=flatten(panel_3), TargetNodeCoeff=flatten(targetnodecoeff_2))  # disabled
cem_bound_origin_node_2 = CEM_Bound_Origin_Node(
    BoundOriginNodeID=flatten(cem_extract_topology_2.OriginNodeID),
    BoundUpOriginNodeX=flatten(boundscoefforiginnode_2),
    BoundLowOriginNodeX=flatten(boundscoefforiginnode_2),
    BoundUpOriginNodeY=flatten(boundscoefforiginnode_2),
    BoundLowOriginNodeY=flatten(boundscoefforiginnode_2),
    BoundUpOriginNodeZ=flatten(panel),
    BoundLowOriginNodeZ=flatten(panel))  # disabled
cem_bound_trail_2 = CEM_Bound_Trail(BoundTrailID=flatten(series_3), BoundUpTrail=flatten(bounduptrail_2), BoundLowTrail=flatten(boundlowtrail_2))  # disabled
cem_bound_deviation_2 = CEM_Bound_Deviation(BoundDevID=flatten(series_4), BoundUpDev=flatten(boundupdev_2), BoundLowDev=flatten(boundlowdev_2))  # disabled
relativetolerance_2 = Slider(1e-05, range=0..0.1)  # disabled
gradientdelta_2 = Slider(0.003083, range=0..0.1)  # disabled
maxiterations_2 = Slider(100, range=1..100)  # disabled
value_list_2 = ValueList({"LD_AUGLAG", "LD_LBFGS", "LD_SLSQP", "LD_TNEWTON", "LN_BOBYQA", "LN_COBYLA", "LN_SBPLX", "GD_MLSL", "GN_MLSL", "GN_ISRES"}, selected="LD_LBFGS")  # disabled
cem_optimization_setup_2 = CEM_Optimization_Setup(
    TO=cem_target_2,
    BO=cem_bound_origin_node_2,
    BT=cem_bound_trail_2,
    BD=cem_bound_deviation_2,
    GradientDelta=gradientdelta_2,
    RelativeTolerance=relativetolerance_2,
    OptimAlgorithm=value_list_2)  # disabled

wall_thickness = Slider(0.3, range=0..2)
wall_thickness_2 = Slider(0.3, range=0..2)  # disabled

# ----
# FORM FINDING
number_slider = Slider(0.07, range=0..1)
text_tag_3d = TextTag3D(Location=cem_extract_topology.Nodes, Text=cem_extract_topology.NodesID, Size=number_slider, Justification=7)
text_tag_3d_2 = TextTag3D(Location=cem_extract_topology.Edges, Text=cem_extract_topology.EdgesID, Size=number_slider, Justification=7)
panel_4 = Panel("""0
7""")

# ----
# CEM CALCULATION
cem_calculate_structure = CEM_Calculate_Structure(TP=cem_build_topology, N=cem_origin_node, SW=cem_material_properties, O=cem_optimization_setup)
cem_extract_structure = CEM_Extract_Structure(M=cem_calculate_structure)  # -> Nodes, NodesID, Trails, TrailsID, TrailsCol, TrailsMag, Deviations, DeviationsID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
text_tag_3d_3 = TextTag3D(Location=cem_extract_structure.Nodes, Text=cem_extract_structure.NodesID, Size=number_slider, Justification=7)
custom_preview = CustomPreview(
    Geometry=[cem_extract_structure.Trails, cem_extract_structure.Deviations],
    Material=[cem_extract_structure.TrailsCol, cem_extract_structure.DeviationsCol])

text_tag_3d_4 = TextTag3D(Location=cem_extract_structure.Trails, Text=cem_extract_structure.TrailsMag, Size=number_slider, Justification=7)

cull_index = CullIndex(List=cem_extract_structure.Deviations, Indices=panel_4, Wrap=True)
list_item = ListItem(List=cem_extract_structure.Deviations, Index=panel_4, Wrap=True)
chords = Line([cem_extract_structure.Trails, list_item])
verticals = Line(cull_index)

# ----
# Finalizing the Wireframe Geometry
explode = Explode(Curve=[chords, verticals], Recursive=True)  # -> flatten(Segments), flatten(Vertices)
removeduplicatepts = RemoveDuplicatePts(Points=explode.Vertices, Tolerance=0.01)
deconstruct = Deconstruct(Point=removeduplicatepts)  # -> XComponent, YComponent, ZComponent
sort_list = SortList(Keys=deconstruct.XComponent, ValuesValuesA=removeduplicatepts)  # -> Keys, ValuesValuesA
panel_5 = Panel("""0
3
5
7
8
10
12
15""")
list_length_5 = ListLength(List=sort_list.ValuesValuesA)
list_item_2 = ListItem(List=sort_list.ValuesValuesA, Index=panel_5, Wrap=True)
division = Division(A=list_length_5, B="2")
split_list = SplitList(List=sort_list.ValuesValuesA, Index=division)  # -> ListA, ListB
panel_6 = Panel("""0
0
2
4""")
panel_7 = Panel("""1
3
5
7""")
reverse_list = ReverseList(List=split_list.ListB)
list_item_3 = ListItem(List=split_list.ListA, Index=panel_6, Wrap=True)
list_item_4 = ListItem(List=split_list.ListA, Index=panel_7, Wrap=True)
panel_8 = Panel("""0
0
2
4""")
panel_9 = Panel("""1
3
5
7""")
panel_10 = Panel("""7
6""")
panel_11 = Panel("""6
7""")
line = Line(StartPoint=list_item_3, EndPoint=list_item_4)
list_item_5 = ListItem(List=reverse_list, Index=panel_8, Wrap=True)
list_item_6 = ListItem(List=reverse_list, Index=panel_9, Wrap=True)
list_item_7 = ListItem(List=reverse_list, Index=panel_10, Wrap=True)
list_item_8 = ListItem(List=split_list.ListA, Index=panel_11, Wrap=True)
line_2 = Line(StartPoint=list_item_5, EndPoint=list_item_6)
line_3 = Line(StartPoint=list_item_8, EndPoint=list_item_7)
list_item_9 = ListItem(List=split_list.ListA, Index="1", Wrap=True)
list_item_10 = ListItem(List=reverse_list, Index="1", Wrap=True)
cull_index_2 = CullIndex(List=split_list.ListA, Indices="1", Wrap=True)
cull_index_3 = CullIndex(List=reverse_list, Indices="1", Wrap=True)

auxiliary_support_points = Point([cull_index_2, cull_index_3])
support_points = Point([list_item_9, list_item_10])
load_points = Point(list_item_2)
diagonals = Line([line, line_2, line_3])
verticals_2 = Line(verticals)
chords_2 = Line(chords)
finalized_wireframe_geometry = Line([chords_2, verticals_2, diagonals])

# ----
# STRUCTURAL ANALYSIS
material_selection_karamba3d = MaterialSelectionKaramba3D(menu=[dropdown(1), dropdown(2)])
crossection_diameter = Slider(5, range=1..15)
supp = SupportKaramba3D(PosInd=auxiliary_support_points, menu=[buttons(off, off, on, off, off, off)])
line_to_beam_karamba3d = LineToBeamKaramba3D(Line=flatten(finalized_wireframe_geometry), New=True, Remove=True, LimitDistance_m=0.005, Bending=Toggle(False))  # -> Element, Points, Info
unit_y = UnitY(Factor="-5")
cross_section_karamba3d = CrossSectionKaramba3D(
    FamilyNameOfCrossSection="DefaultCroSec",
    Material=material_selection_karamba3d,
    Diameter_cm=crossection_diameter,
    WallThickness_cm=wall_thickness,
    mode="Circular Hollow")
support_karamba3d = SupportKaramba3D(PosInd=support_points, menu=[buttons(on, on, on, on, on, on)])  # -> flatten(Support)
loads_karamba3d = LoadsKaramba3D(ForceVector=unit_y, Local=False, PosInd=load_points, LCase=0, mode="Point")
assemble_model_karamba3d = AssembleModelKaramba3D(
    Elem=line_to_beam_karamba3d.Element,
    Support=flatten([support_karamba3d, supp]),
    Load=loads_karamba3d,
    CrossSection=cross_section_karamba3d,
    LimitDistance_m=0.005)  # -> Model, Info, Mass_kg, CenterOfGravity
l_300 = Panel("1.67")
analyze_karamba3d = AnalyzeKaramba3D(Model=assemble_model_karamba3d.Model)  # -> CalculatedModel, flatten(MaximumDisplacement_cm), ResultingForceOfGravity_kN, ElasticEnergy_kNm
max_displacement = Panel(analyze_karamba3d.MaximumDisplacement_cm)
division_2 = Division(A=max_displacement, B=l_300)
panel_12 = Panel(division_2)
model_view_karamba3d = ModelViewKaramba3D(Model=analyze_karamba3d.CalculatedModel, ResultFactors=1, ResultCase=-1)  # -> Model, DeformedMesh, DeformedAxes, DeformedModel
beam_view_karamba3d = BeamViewKaramba3D(Model=model_view_karamba3d.Model)  # -> Model, MeshesOfRenderedBeams, DeformedBeamAxes, LegendColors, LegendTags
beam_forces_karamba3d = BeamForcesKaramba3D(AnalyzedModel=beam_view_karamba3d.Model, LCase=-1, MaximumDistanceBetweenResults_m=-1, NumberOfResultsPerBeamElement=1)  # -> AnalyzedModel, NormalForce_kN, ShearForceVz_kN, ShearForceVy_kN, BendingMomentMt_kNm, BendingMomentMy_kNm, BendingMomentMz_kNm
legend = Legend(Colour=beam_view_karamba3d.LegendColors, Tags=beam_view_karamba3d.LegendTags, LegendType=1)

# ----
# FORM FINDING
number_slider_2 = Slider(0.07, range=0..1)  # disabled
text_tag_3d_5 = TextTag3D(Location=cem_extract_topology_2.Nodes, Text=cem_extract_topology_2.NodesID, Size=number_slider_2, Justification=7)  # disabled
text_tag_3d_6 = TextTag3D(Location=cem_extract_topology_2.Edges, Text=cem_extract_topology_2.EdgesID, Size=number_slider_2, Justification=7)  # disabled
panel_13 = Panel("""0
7""")  # disabled

# ----
# CEM CALCULATION
cem_calculate_structure_2 = CEM_Calculate_Structure(TP=cem_build_topology_2, N=cem_origin_node_2, SW=cem_material_properties_2, O=cem_optimization_setup_2)  # disabled
cem_extract_structure_2 = CEM_Extract_Structure(M=cem_calculate_structure_2)  # -> Nodes, NodesID, Trails, TrailsID, TrailsCol, TrailsMag, Deviations, DeviationsID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; disabled
text_tag_3d_7 = TextTag3D(Location=cem_extract_structure_2.Nodes, Text=cem_extract_structure_2.NodesID, Size=number_slider_2, Justification=7)  # disabled
custom_preview_2 = CustomPreview(
    Geometry=[cem_extract_structure_2.Trails, cem_extract_structure_2.Deviations],
    Material=[cem_extract_structure_2.TrailsCol, cem_extract_structure_2.DeviationsCol])  # disabled

text_tag_3d_8 = TextTag3D(Location=cem_extract_structure_2.Trails, Text=cem_extract_structure_2.TrailsMag, Size=number_slider_2, Justification=7)  # disabled

cull_index_4 = CullIndex(List=cem_extract_structure_2.Deviations, Indices=panel_13, Wrap=True)  # disabled
list_item_11 = ListItem(List=cem_extract_structure_2.Deviations, Index=panel_13, Wrap=True)  # disabled
chords_3 = Line([cem_extract_structure_2.Trails, list_item_11])  # disabled
verticals_3 = Line(cull_index_4)  # disabled

# ----
# Finalizing the Wireframe Geometry
explode_2 = Explode(Curve=[chords_3, verticals_3], Recursive=True)  # -> flatten(Segments), flatten(Vertices); disabled
removeduplicatepts_2 = RemoveDuplicatePts(Points=explode_2.Vertices, Tolerance=0.01)  # disabled
deconstruct_2 = Deconstruct(Point=removeduplicatepts_2)  # -> XComponent, YComponent, ZComponent; disabled
sort_list_2 = SortList(Keys=deconstruct_2.XComponent, ValuesValuesA=removeduplicatepts_2)  # -> Keys, ValuesValuesA; disabled
panel_14 = Panel("""0
3
5
7
8
10
12
15""")  # disabled
list_length_6 = ListLength(List=sort_list_2.ValuesValuesA)  # disabled
list_item_12 = ListItem(List=sort_list_2.ValuesValuesA, Index=panel_14, Wrap=True)  # disabled
panel_15 = Panel("2")  # disabled
division_3 = Division(A=list_length_6, B=panel_15)  # disabled
split_list_2 = SplitList(List=sort_list_2.ValuesValuesA, Index=division_3)  # -> ListA, ListB; disabled
panel_16 = Panel("""0
0
2
4""")  # disabled
panel_17 = Panel("""1
3
5
7""")  # disabled
reverse_list_2 = ReverseList(List=split_list_2.ListB)  # disabled
list_item_13 = ListItem(List=split_list_2.ListA, Index=panel_16, Wrap=True)  # disabled
list_item_14 = ListItem(List=split_list_2.ListA, Index=panel_17, Wrap=True)  # disabled
panel_18 = Panel("""0
0
2
4""")  # disabled
panel_19 = Panel("""1
3
5
7""")  # disabled
panel_20 = Panel("""7
6""")  # disabled
panel_21 = Panel("""6
7""")  # disabled
line_4 = Line(StartPoint=list_item_13, EndPoint=list_item_14)  # disabled
list_item_15 = ListItem(List=reverse_list_2, Index=panel_18, Wrap=True)  # disabled
list_item_16 = ListItem(List=reverse_list_2, Index=panel_19, Wrap=True)  # disabled
list_item_17 = ListItem(List=reverse_list_2, Index=panel_20, Wrap=True)  # disabled
list_item_18 = ListItem(List=split_list_2.ListA, Index=panel_21, Wrap=True)  # disabled
line_5 = Line(StartPoint=list_item_15, EndPoint=list_item_16)  # disabled
line_6 = Line(StartPoint=list_item_18, EndPoint=list_item_17)  # disabled
panel_22 = Panel("1")  # disabled
panel_23 = Panel("1")  # disabled
list_item_19 = ListItem(List=split_list_2.ListA, Index=panel_22, Wrap=True)  # disabled
list_item_20 = ListItem(List=reverse_list_2, Index=panel_23, Wrap=True)  # disabled
panel_24 = Panel("1")  # disabled
panel_25 = Panel("1")  # disabled
cull_index_5 = CullIndex(List=split_list_2.ListA, Indices=panel_24, Wrap=True)  # disabled
cull_index_6 = CullIndex(List=reverse_list_2, Indices=panel_25, Wrap=True)  # disabled

auxiliary_support_points_2 = Point([cull_index_5, cull_index_6])  # disabled
support_points_2 = Point([list_item_19, list_item_20])  # disabled
load_points_2 = Point(list_item_12)  # disabled
diagonals_2 = Line([line_4, line_5, line_6])  # disabled
verticals_4 = Line(verticals_3)  # disabled
chords_4 = Line(chords_3)  # disabled
finalized_wireframe_geometry_2 = Line([chords_4, verticals_4, diagonals_2])  # disabled

# ----
# STRUCTURAL ANALYSIS
material_selection_karamba3d_2 = MaterialSelectionKaramba3D(menu=[dropdown(1), dropdown(2)])  # disabled
crossection_diameter_2 = Slider(5, range=1..15)  # disabled
supp_2 = SupportKaramba3D(PosInd=auxiliary_support_points_2, menu=[buttons(off, off, on, off, off, off)])  # disabled
toggle = BooleanToggle(False)  # disabled
panel_26 = Panel("-5")  # disabled
line_to_beam_karamba3d_2 = LineToBeamKaramba3D(Line=flatten(finalized_wireframe_geometry_2), New=True, Remove=True, LimitDistance_m=0.005, Bending=toggle)  # -> Element, Points, Info; disabled
unit_y_2 = UnitY(Factor=panel_26)  # disabled
cross_section_karamba3d_2 = CrossSectionKaramba3D(
    FamilyNameOfCrossSection="DefaultCroSec",
    Material=material_selection_karamba3d_2,
    Diameter_cm=crossection_diameter_2,
    WallThickness_cm=wall_thickness_2,
    mode="Circular Hollow")  # disabled
support_karamba3d_2 = SupportKaramba3D(PosInd=support_points_2, menu=[buttons(on, on, on, on, on, on)])  # -> flatten(Support); disabled
loads_karamba3d_2 = LoadsKaramba3D(ForceVector=unit_y_2, Local=False, PosInd=load_points_2, LCase=0, mode="Point")  # disabled
assemble_model_karamba3d_2 = AssembleModelKaramba3D(
    Elem=line_to_beam_karamba3d_2.Element,
    Support=flatten([support_karamba3d_2, supp_2]),
    Load=loads_karamba3d_2,
    CrossSection=cross_section_karamba3d_2,
    LimitDistance_m=0.005)  # -> Model, Info, Mass_kg, CenterOfGravity; disabled
l_300_2 = Panel("1.67")  # disabled
analyze_karamba3d_2 = AnalyzeKaramba3D(Model=assemble_model_karamba3d_2.Model)  # -> CalculatedModel, flatten(MaximumDisplacement_cm), ResultingForceOfGravity_kN, ElasticEnergy_kNm; disabled
max_displacement_2 = Panel(analyze_karamba3d_2.MaximumDisplacement_cm)  # disabled
division_4 = Division(A=max_displacement_2, B=l_300_2)  # disabled
panel_27 = Panel(division_4)  # disabled
model_view_karamba3d_2 = ModelViewKaramba3D(Model=analyze_karamba3d_2.CalculatedModel, ResultFactors=1, ResultCase=-1)  # -> Model, DeformedMesh, DeformedAxes, DeformedModel; disabled
beam_view_karamba3d_2 = BeamViewKaramba3D(Model=model_view_karamba3d_2.Model)  # -> Model, MeshesOfRenderedBeams, DeformedBeamAxes, LegendColors, LegendTags; disabled
beam_forces_karamba3d_2 = BeamForcesKaramba3D(AnalyzedModel=beam_view_karamba3d_2.Model, LCase=-1, MaximumDistanceBetweenResults_m=-1, NumberOfResultsPerBeamElement=1)  # -> AnalyzedModel, NormalForce_kN, ShearForceVz_kN, ShearForceVy_kN, BendingMomentMt_kNm, BendingMomentMy_kNm, BendingMomentMz_kNm; disabled
legend_2 = Legend(Colour=beam_view_karamba3d_2.LegendColors, Tags=beam_view_karamba3d_2.LegendTags, LegendType=1)  # disabled
