# Grasshopper definition ur_robot_model_bridgeTheGap.ghx (Grasshopper 1.0.7)

reload = Button()
py = PythonScript(reload=reload)
# ---------- py: Python ----------
from compas_rhino.utilities.misc import get_tolerance
from compas_rhino.utilities.misc import unload_modules

from compas_ghpython import unload_modules
unload_modules("compas")
unload_modules("compas_fab")
unload_modules("roslibpy")
# ---------- end py ----------

py_2 = PythonScript()  # -> DATA
# ---------- py_2: Python ----------
import os
import getpass

username = getpass.getuser()
USER_FOLDER = os.path.abspath(os.path.join("C:/Users/", username))
DATA = os.path.abspath(os.path.join(USER_FOLDER,"workspace/projects/ur_fabrication_control/data"))

print(USER_FOLDER)
print(DATA)
# ---------- end py_2 ----------

# ----
# Robot Model
# Load Model
list = ValueList({"ur_description", "ur_e_description", "ur_setups"}, selected="ur_description")
list_2 = ValueList({"ur3.urdf", "ur3_rot.urdf", "ur5.urdf", "ur10.urdf", "ur3e.urdf", "ur5e.urdf", "ur10e.urdf", "ur10e_rot.urdf"}, selected="ur3_rot.urdf")
list_3 = ValueList({"ur3.srdf", "ur5.srdf", "ur10.srdf", "ur3e.srdf", "ur5e.srdf", "ur10e.srdf"}, selected="ur3.srdf")
py_3 = PythonScript(data_path=py_2, package=list, urdf_name=list_2, srdf_name=list_3)  # -> loaders, urdf_filename, srdf_filename
# ---------- py_3: Python ----------
import os
from compas.robots import LocalPackageMeshLoader

path = os.path.join(data_path, "robot_description")

#loaders
packages = ["ur_description", "ur_e_description", "ur_end_effectors", "ur_setups"]
loaders = [LocalPackageMeshLoader(path, pck) for pck in packages]

#files
package_path = os.path.join(path, package)
print package_path

urdf_filename = os.path.join(package_path, "urdf", urdf_name)
srdf_filename = os.path.join(package_path, srdf_name)

assert os.path.isfile(urdf_filename)
assert os.path.isfile(srdf_filename)
# ---------- end py_3 ----------
units = ValueList({"m": 1, "cm": 100, "mm": 1000}, selected="m")
load = Button()
create = PythonScript(load=load, loaders=py_3.loaders, urdf_filename=py_3.urdf_filename, srdf_filename=py_3.srdf_filename, scale_factor=units)  # -> out, robot; inputs load: Boolean, loaders: list
# ---------- create: Python ----------
import os
from scriptcontext import sticky as st

import compas

from compas.robots import RobotModel
from compas.robots import LocalPackageMeshLoader

from compas_fab.robots import Robot
from compas_fab.robots import RobotSemantics

from compas_fab.ghpython import RobotArtist

compas.PRECISION = '12f'

# store robot in component
guid = str(ghenv.Component.InstanceGuid)
robot_key = "robot_" + guid

if robot_key not in st:
    st[robot_key] = None

print loaders
if load:
    model = RobotModel.from_urdf_file(urdf_filename)
    
    model.load_geometry(*loaders)
    artist = RobotArtist(model)
    semantics = RobotSemantics.from_srdf_file(srdf_filename, model)
    robot = Robot(model, artist, semantics, client=None)

    
    st[robot_key] = robot

robot = st[robot_key]


if robot:
    robot.scale(scale_factor)
# ---------- end create ----------
robot = Data(create.robot)

# ----
# Tool
list_4 = ValueList({"measurement_tool": 0, "air_pick_15mm": 1}, selected="air_pick_15mm")
panel = Panel("Attach a custom tool")
show = BooleanToggle(False)
python = PythonScript(data_path=py_2, tool=list_4, show=show)  # -> tool, M
# ---------- python: Python ----------
import os, math
from compas.geometry import Frame, Rotation
from compas.datastructures import Mesh
from compas_ghpython.artists import MeshArtist
from compas_fab.robots import Tool

tolerance = 0

if tool == 0:
    filename = 'measurement_tool_zaxis.stl'
    ee_frame = Frame([0, 0, 0.109], [1, 0, 0], [0, 1, 0])

elif tool == 1:
    filename = 'hrca_airpick_zaxis_withoutacm.stl'
    ee_frame = Frame([0, 0, 0.158 + tolerance], [1, 0, 0], [0, 1, 0])


data_path = os.path.join(data_path, "tool_geometry")
fullfilename = os.path.join(data_path, filename)
print fullfilename

ee_mesh = Mesh.from_stl(fullfilename)

#R = Rotation.from_axis_and_angle(ee_frame.zaxis, math.radians(180), point=ee_frame.point)
#ee_frame.transform(R)

if show:
    artist = MeshArtist(ee_mesh)
    M = artist.draw()

tool = Tool(ee_mesh, ee_frame)
# ---------- end python ----------
py_4 = PythonScript(robot=robot, tool=python.tool, attach=Toggle(True))  # -> a
# ---------- py_4: Python ----------
if attach:
    robot.attach_tool(tool)
else:
    robot.detach_tool()
# ---------- end py_4 ----------

# ----
# Pickup Plane Reference Point (bottom right)
number_slider = Slider(0, range=-2..2)
X = UnitX(Factor=1)
Y = UnitY(Factor=1)
pt = ConstructPoint(XCoordinate=Slider(0.3, range=-2..2), YCoordinate=Slider(0.3, range=-2..2), ZCoordinate=number_slider)
rev = Reverse(Vector=X)
pl = ConstructPlane(Origin=pt, XAxis=rev, YAxis=Y)

load_2 = Button()

# ----
# AIM
fictive_geometry_input = GhPythonScript()  # -> out, geometry
# ---------- fictive_geometry_input: Python ----------
__author__ = "julia"
__version__ = "2021.10.14"

import rhinoscriptsyntax as rs

part1 = [[.28, .22, .0], [-1.0, 0.0, 0.0], [0.0, 1.0, 0.0], [.12, 0.04, 0.02]]
part2 = [[.26, .12, .0], [-1.0, 0.0, 0.0], [0.0, 1.0, 0.0], [.19, 0.04, 0.02]]
part3 = [[.24, .29, .0], [-1.0, 0.0, 0.0], [0.0, 1.0, 0.0], [.16, 0.04, 0.02]]
part4 = [[.12, .23, .0], [-1.0, 0.0, 0.0], [0.0, 1.0, 0.0], [.09, 0.04, 0.02]]

geometry = [part1, part2, part3, part4]
# ---------- end fictive_geometry_input ----------
path = GhPythonScript(load=load_2)  # -> out, DATA
# ---------- path: Python ----------
__author__ = "julia"
__version__ = "2021.10.15"

import rhinoscriptsyntax as rs
import os
import getpass
import sys
if load:
    username = getpass.getuser()
    USER_FOLDER = os.path.abspath(os.path.join("C:/Users/", username))
    DATA = os.path.abspath(os.path.join(USER_FOLDER,"workspace/projects/bridgethegap_sample_assembly/src/bridgethegap_example/assembly"))
    print(DATA)
    if not DATA in sys.path:
        sys.path.append(DATA)
# ---------- end path ----------
aim = GhPythonScript(
    DATA=path.DATA,
    geometry=fictive_geometry_input.geometry,
    safe_plane_distance=Slider(0.23, range=0..0.5),
    pick_plane_reference=pl)  # -> out, myAssembly; inputs geometry: list
# ---------- aim: Python ----------
from __future__ import absolute_import
from __future__ import print_function

__author__ = "julia"
__version__ = "2021.10.14"

import rhinoscriptsyntax as rs
import sys
from compas.geometry import Frame, Point, Vector
from compas.geometry import Point, Frame, Vector
from assembly import BridgeAssembly
from element import BridgeElement
if not DATA in sys.path:
    sys.path.append(DATA)

my_elements = []
myFrame = Frame(Point(0.2, 0.2, 0.2), Vector(-1,0,0), Vector(0,1,0))

pick_frame_reference = Frame(pick_plane_reference.Origin, pick_plane_reference.XAxis,
    pick_plane_reference.YAxis)


for id, object in enumerate(geometry):
    object_frame = Frame(object[0], object[1], object[2])
    object_profile = object[3]
    my_element = BridgeElement(id, object_frame, object_profile)
    my_elements.append(my_element)

myAssembly = BridgeAssembly(my_elements, pick_frame_reference, safe_plane_distance)
myAssembly.prepare_assembly()
# ---------- end aim ----------

panel_2 = Panel(py_2)

# ----
# Info
info = PythonScript(robot=robot)  # -> out, main_group_name
# ---------- info: Python ----------
if robot:
    robot.info()
    main_group_name = robot.main_group_name
# ---------- end info ----------
panel_3 = Panel(info.out)

python_2 = GhPythonScript(myAssembly=aim.myAssembly, board_id=Slider(2, range=0..4), step=Slider(0, range=0..5))  # -> out, plane_WCS, drop_meshes, pick_meshes, attached_collision_meshes; inputs board_id: Int32, step: Int32
# ---------- python_2: Python ----------
__author__ = "julia"
__version__ = "2021.10.15"

import rhinoscriptsyntax as rs
import Rhino.Geometry as rg

drop_meshes = []
pick_meshes = []

for element in myAssembly.elements:
    if element.id < board_id:
        drop_meshes.append(element.drop_mesh)
    if element.id == board_id:
        # create the plane for the robotic path planning
        plane = element.path[step]
        plane_WCS = rg.Plane(rg.Point3d(plane[0][0],plane[0][1],plane[0][2]),
            xDirection= rg.Vector3d(plane[1][0],plane[1][1],plane[1][2]),
            yDirection= rg.Vector3d(plane[2][0],plane[2][1],plane[2][2]))
        # define the meshes that are to be visualized
        pick_meshes.append(element.pick_mesh)
        drop_meshes.append(element.drop_mesh)
        break
# ---------- end python_2 ----------

# ---- group: forward kinematics
# Configuration
a1 = Slider(0, range=-360..360)
a2 = Slider(-23, range=-360..360)
a3 = Slider(17, range=-360..360)
a5 = Slider(-90, range=-360..360)
a6 = Slider(90, range=-360..360)
a4 = Slider(-85, range=-360..360)
jp = GhPythonScript()  # -> joint_positions
# ---------- jp: Python ----------
import math

joint_positions = [0,-90,90,-90,-90,90]
joint_positions = [math.radians(a) for a in joint_positions]
#joint_positions = [-3.136, -0.328, -1.218, 3.129, 0.852, 0.008]
#joint_positions = [0] * 6



#joint_positions = [1.6239667567485938, 0.25439606475392273, 4.409424838594969-2*3.14, 3.1901607306255908, 1.5707963267948954, 0.053170429953696939]
#joint_positions = [1.598543436748912, 0.23021224965157744, 4.712232135219824-2*3.14, 6.0531299026928744, 4.7123889803846915, 0.027747109954015234]
#joint_positions = [-1.1373533430447322, 4.0117247163121572, 5.4083762087596021-2*3.14, 1.5754733624925168, 4.7123889803846879, 3.5750356373399574]
print joint_positions
# ---------- end jp ----------
forward_kinematics = PythonScript(robot=robot, set_joint_positions=Button(), joint_positions=jp, a1=a1, a2=a2, a3=a3, a4=a4, a5=a5, a6=a6)  # -> full_configuration; inputs joint_positions: list
# ---------- forward_kinematics: Python ----------
import math
import Grasshopper
from compas.robots import Joint
from compas_fab.robots import Configuration

if set_joint_positions:

    j = 0
    for i in range(ghenv.Component.Params.Input.Count):
        nslider = ghenv.Component.Params.Input[i].Sources[0]
        if nslider.GetType() == Grasshopper.Kernel.Special.GH_NumberSlider:
            nslider.TrySetSliderValue(math.degrees(joint_positions[j]))
            j += 1

if robot:
    joint_positions = [a1, a2, a3, a4, a5, a6]
    joint_types = robot.get_configurable_joint_types()
    for i, joint_type in enumerate(joint_types):
        if joint_type == Joint.REVOLUTE:
            joint_positions[i] = math.radians(joint_positions[i])
    full_configuration = Configuration(joint_positions, joint_types)
    
print(full_configuration)
# ---------- end forward_kinematics ----------

# ----
show_drop_mesh = BooleanToggle(True)
show_pick_mesh = BooleanToggle(True)
pln = Plane(python_2.plane_WCS)

# ---- group: inverse kinematics
select_configuration = Slider(0, range=0..7)
inverse = PythonScript(robot=robot, plane_WCS=pln, idx=select_configuration)  # -> out, configuration; inputs plane_WCS: Plane, idx: Int32
# ---------- inverse: Python ----------
import Rhino.Geometry as rg
import math
from compas.geometry import Frame, Transformation, Rotation
from compas_fab.robots import Configuration
from ur_fabrication_control.kinematics.ur_kinematics import inverse_kinematics
from ur_fabrication_control.kinematics.ur_params import ur_params
from compas_ghpython import draw_frame


tcp_WCS = Frame(plane_WCS.Origin, plane_WCS.XAxis, plane_WCS.YAxis)

# transform frame to robot coordinate system
tcp_RCS = robot.to_local_coordinates(tcp_WCS)
tool0_RCS = robot.from_tcf_to_t0cf([tcp_RCS])[0]

# calculate solutions to frame
ur_params = ur_params[robot.name] # get the parameters according to the robot model
solutions = inverse_kinematics(tool0_RCS, ur_params)

if not len(solutions):
    joint_values = [0,0,0,0,0,0]
    configuration = Configuration.from_revolute_values(joint_values)
else:
    joint_values = solutions[idx]
    #print joint_values
    
    ### ***** HACK ***** ##### TODO: CHECK!!!
    for i, v in enumerate(joint_values):
        if v > math.pi:
            v -= 2*math.pi
        if v < -math.pi:
            v += 2*math.pi
        joint_values[i] = v
    ### ***** HACK ***** ##### TODO: CHECK!!!
    
    configuration = [Configuration.from_revolute_values(joint_values)]

print(configuration)
# ---------- end inverse ----------

# ----
list_5 = ValueList({"0 forward_kinematics": 0, "1 inverse_kinematics": 1}, selected="1 inverse_kinematics")
filter = StreamFilter(Gate=list_5, Stream0=forward_kinematics, Stream1=inverse.configuration)

# ----
# Visualisation
show_end_effector_frame = BooleanToggle(True)
show_base_frame = BooleanToggle(False)
show_collision = BooleanToggle(False)
show_frames = BooleanToggle(False)
show_visual = BooleanToggle(True)
show_acm = BooleanToggle(False)
visualize = PythonScript(
    robot=robot,
    group=info.main_group_name,
    configuration=filter,
    redraw=py_4,
    drop_meshes=python_2.drop_meshes,
    pick_meshes=python_2.pick_meshes,
    show_visual=show_visual,
    show_collision=show_collision,
    show_end_effector_frame=show_end_effector_frame,
    show_frames=show_frames,
    show_base_frame=show_base_frame,
    show_acm=show_acm,
    show_drop_mesh=show_drop_mesh,
    show_pick_mesh=show_pick_mesh)  # -> out, robot, visual, collision, attached_meshes, model_geometry, pick_geometry, frames, ee_frame, base_frame; inputs redraw: list, drop_meshes: list, pick_meshes: list, attached_collision_meshes: list
# ---------- visualize: Python ----------
from compas.geometry import Vector
from compas.geometry import Point
from compas.geometry import Transformation
from compas.geometry import Frame
from compas_ghpython.artists import MeshArtist
from compas_fab.robots import Configuration

print(configuration)

if robot and configuration:
    
    robot.update(configuration, visual=show_visual, collision=show_collision)

    if show_visual:
        visual = robot.artist.draw_visual()

    if show_collision:
        collision = robot.artist.draw_collision()
    
    frames = robot.transformed_frames(configuration, group)

    if show_base_frame:
        base_frame = frames[0]

    if show_end_effector_frame:
        ee_frame = robot.forward_kinematics(configuration, group)
        print("End-effector", ee_frame)
    
    if not show_frames:
        frames = None

    frame = robot.forward_kinematics(configuration, options=dict(solver='model', link_name=robot.attached_tool.link_name))
    robot.artist.update_tool(visual=visual, collision=collision, transformation=Transformation.from_frame_to_frame(Frame.worldXY(), frame))
    
    if show_acm:
        M = []
        for acm in attached_collision_meshes:
            frame = robot.forward_kinematics(configuration, options=dict(solver='model', link_name=acm.link_name))
            T = Transformation.from_frame_to_frame(Frame.worldXY(), frame)
            mesh = acm.collision_mesh.mesh.transformed(T)
            M.append(MeshArtist(mesh).draw())
        attached_meshes = M
    
    if show_drop_mesh:
        model_geometry = []
        for my_mesh in drop_meshes:
            model_geometry.append(MeshArtist(my_mesh).draw())
            
    if show_pick_mesh:
        pick_geometry = []
        if pick_meshes:
            for my_mesh in pick_meshes:
                pick_geometry.append(MeshArtist(my_mesh).draw())
# ---------- end visualize ----------
geo = Geometry(visualize.collision)
geo_2 = Geometry(visualize.visual)
draw = GhPythonScript(frames=[visualize.frames, visualize.ee_frame, visualize.base_frame], scale=Slider(0.1, range=0..1))  # -> P, V, C, W; inputs frames: list
# ---------- draw: Python ----------
from System.Drawing import Color
from compas_ghpython.utilities import draw_frame

red = Color.FromArgb(255, 0, 0)
green = Color.FromArgb(0, 255, 0)
blue = Color.FromArgb(0, 0, 255)

P = []
V = []
C = []

scale = float(scale)

for frame in frames:
    if not frame:
        continue
    plane = draw_frame(frame)
    P += [plane.Origin] * 3
    V.append(plane.XAxis * scale)
    V.append(plane.YAxis * scale)
    V.append(plane.ZAxis * scale)
    C += [red, green, blue]

W = 3
# ---------- end draw ----------
preview = CustomPreview(
    Geometry=[visualize.attached_meshes, visualize.model_geometry, visualize.pick_geometry],
    Shader=ColourSwatch(SwatchColor=RGB(168, 158, 118)))
vdisex = VectorDisplayEx(Point=draw.P, Vector=draw.V, Colour=draw.C, Width=draw.W)
preview_2 = CustomPreview(Geometry=geo_2, Shader=ColourSwatch(SwatchColor=RGB(105, 105, 105)))
